# Grasshopper definition robotic_setup_alte_schmiede_artist.ghx (Grasshopper 1.0.7)

reload = Button()

# ----
# Filepath
panel = Panel("abb_linear_axis_overhead_two_robots.urdf")
list = ValueList({"abb_linear_axis_overhead"}, selected="abb_linear_axis_overhead")
list_2 = ValueList({"abb_irb4600_40_255", "staubli_tx60l"}, selected="abb_irb4600_40_255")
list_3 = ValueList({"abb_end_effectors", "abb_irb4600_40_255", "staubli_tx60l"}, selected="abb_end_effectors")
py = PythonScript()  # -> ghfile_path
# ---------- py: Python ----------
import os

filepath = ghenv.Component.OnPingDocument().FilePath
ghfile_path = os.path.dirname(filepath)
# ---------- end py ----------
py_2 = PythonScript(ghfile_path=py)  # -> robot_description
# ---------- py_2: Python ----------
import os

robot_description = os.path.join(ghfile_path, "..", "data", "robot_description")
robot_description = os.path.abspath(robot_description)
# ---------- end py_2 ----------
py_3 = PythonScript(path=py_2, packages=[list_2, list, list_3])  # -> loaders; inputs packages: list
# ---------- py_3: Python ----------
from compas.robots import LocalPackageMeshLoader

loaders = []
for package in packages:
    loaders.append(LocalPackageMeshLoader(path, package))
    
    
print loaders
# ---------- end py_3 ----------
py_4 = PythonScript(path=py_2, package=list, urdf_name=panel)  # -> package_path, urdf_filename
# ---------- py_4: Python ----------
import os

package_path = os.path.join(path, package)

urdf_filename = os.path.join(package_path, "urdf", urdf_name)

print urdf_filename
assert os.path.isfile(urdf_filename)
# ---------- end py_4 ----------

py_5 = PythonScript(reload=reload)
# ---------- py_5: Python ----------
if reload:
    from compas_ghpython import unload_modules
    unload_modules('compas')
    unload_modules("compas_fab")
    unload_modules("ur_online_control")
# ---------- end py_5 ----------

# ----
# Element
# Predefine an element and its dimensions
# Visualise the defined element
show = BooleanToggle(True)
# Brick Assembly
elem_def = GhPythonScript()  # -> out, elem_full, elem_half
# ---------- elem_def: Python ----------
import os
import sys
import json

from compas.geometry import Frame
from compas.geometry import Vector
from compas.geometry import Box
from compas_fab.robots import Configuration

from ur_online_control.assembly import Element




# 
width = 0.0115*3
length = 0.024*3
height = 0.05*3

#tolerance_vector = Vector(0, 0, 1.)
#savelevel_vector = Vector(0, 0, 50.)

#picking_frame = Frame([-0.43, 0, height], [1, 0, 0], [0, 1, 0])
#picking_configuration = Configuration.from_revolute_values([-6.027, 4.443, -2.313, 5.724, 1.571, -2.885])

# full brick
box_frame = Frame([-length/2., -width/2., 0.], [1, 0, 0], [0, 1, 0]) #center of the box frame 
box = Box(box_frame, length, width, height) 
gripping_frame = Frame([0, 0, height], [1, 0, 0], [0, -1, 0])
elem_full = Element.from_shape(box, gripping_frame)
elem_full.id = "full"

# half brick
box_frame = Frame([-length/4., -width/2., 0.], [1, 0, 0], [0, 1, 0]) #center of the box frame 
box = Box(box_frame, length/2, width, height) 
gripping_frame = Frame([0, 0, height], [1, 0, 0], [0, -1, 0])
elem_half = Element.from_shape(box, gripping_frame)
elem_half.id = "half"
# ---------- end elem_def ----------
draw = PythonScript(elem_full=elem_def.elem_full, elem_half=elem_def.elem_half, show=show)  # -> M, F, S
# ---------- draw: Python ----------
from compas.geometry import Transformation
from compas.geometry import Frame
from compas.datastructures import mesh_transformed
from compas_ghpython.artists import MeshArtist
from compas_ghpython import draw_frame

if show:
    artist = MeshArtist(elem_full.mesh)
    M = [artist.draw_mesh()]
    F = [draw_frame(elem_full.frame)]
    S = [draw_frame(elem_full._source.frame)]
    
    artist = MeshArtist(elem_half.mesh)
    M += [artist.draw_mesh()]
    F += [draw_frame(elem_half.frame)]
    S += [draw_frame(elem_half.frame)]
# ---------- end draw ----------

y_axis = Curve(<curve referenced from the Rhino model>)
x_axis = Curve(<curve referenced from the Rhino model>)

# ----
# Robot
load = Button()
python = PythonScript(loaders=py_3, urdf_filename=py_4.urdf_filename, load=load)  # -> robot; inputs loaders: list
# ---------- python: Python ----------
from scriptcontext import sticky as st

import compas

from compas.robots import RobotModel
from compas.robots import GithubPackageMeshLoader
from compas_fab.ghpython import RobotArtist

# Robot meshes are usually in meters
# Set a high percision to prevent parsing errors
# and configure Rhino itself in meters
compas.PRECISION = '12f'

# Store robot in component-based key
robot_key = 'robot_{}'.format(str(ghenv.Component.InstanceGuid))

if robot_key not in st:
    st[robot_key] = None

if load:

    robot = RobotModel.from_urdf_file(urdf_filename)
    robot.load_geometry(*loaders)
    robot.artist = RobotArtist(robot)

    st[robot_key] = robot

robot = st[robot_key]
# ---------- end python ----------
robot = Data(python)

plane = PythonScript(plane_axes=[x_axis, y_axis])  # -> plane; inputs plane_axes: list of Curve
# ---------- plane: Python ----------
import Rhino.Geometry as rg

x_axis, y_axis = plane_axes

x_axis = rg.Line(x_axis.PointAtStart, x_axis.PointAtEnd)
y_axis = rg.Line(y_axis.PointAtStart, y_axis.PointAtEnd)

if x_axis.From.DistanceTo(y_axis.From) < 0.01:
    origin = x_axis.From
    xvec = x_axis.Direction
    yvec = y_axis.Direction
elif x_axis.To.DistanceTo(y_axis.To) < 0.01:
    origin = x_axis.To
    xvec = -x_axis.Direction
    yvec = -y_axis.Direction
elif x_axis.From.DistanceTo(y_axis.To) < 0.01:
    origin = x_axis.From
    xvec = x_axis.Direction
    yvec = -y_axis.Direction
elif x_axis.To.DistanceTo(y_axis.From) < 0.01:
    origin = x_axis.To
    xvec = -x_axis.Direction
    yvec = y_axis.Direction

plane = rg.Plane(origin, xvec, yvec)
# ---------- end plane ----------

# ----
# Assembly
toggle = BooleanToggle(True)
cp = Plane(PlaneXY(0, 0, 0))
cp_new = Plane(plane)
generate_assembly = GhPythonScript(centerplane=cp, elem_full=elem_def.elem_full, elem_half=elem_def.elem_half, transform=toggle, ptransf=cp_new)  # -> assembly, planes; inputs ptransf: Plane
# ---------- generate_assembly: Python ----------
import Rhino.Geometry as rg
import math
from scriptcontext import sticky as st


from compas.geometry import Frame
from compas.geometry import Transformation
from compas.geometry import Rotation
from compas.geometry import Translation
from compas.geometry import Point

from compas_ghpython.geometry import xtransformed
from compas_ghpython import draw_frame

from ur_online_control.assembly import Assembly
from ur_online_control.assembly import Element

import Rhino.Geometry as rg



width, length, height = [elem_full._source.xsize, elem_full._source.ysize, elem_full._source.zsize]
#print(width, length, height)

COURSES = 20
BRICKS_PER_COURSE = 5

MORTAR_PERPENDS = 0.015
MORTAR_BEDS = 0.003

total_length = BRICKS_PER_COURSE * width + (BRICKS_PER_COURSE - 1) * MORTAR_PERPENDS
gap_even = MORTAR_PERPENDS
gap_uneven = MORTAR_PERPENDS
#gap_uneven = (total_length - (BRICKS_PER_COURSE * (width)))/BRICKS_PER_COURSE



assembly = Assembly() # initialize an empty assembly class
planes = [] # just for vizualisation


#cp.Rotate(math.radians(90), cp.ZAxis, cp.Origin)
#cp.Translate(rg.Vector3d(0,0,1))
cp = centerplane
cf = Frame(cp.Origin, cp.XAxis, cp.YAxis)

for row in range(COURSES):
    dy = row * height
    half_brick_ends = row % 2 != 0
    gap = gap_even if row % 2 == 0 else gap_uneven
    dx = 0

    bricks_in_course = BRICKS_PER_COURSE + (1 if half_brick_ends else 0)
    for j in range(bricks_in_course):

        first = j == 0
        last = j == bricks_in_course - 1

        is_half_brick = (first or last) and half_brick_ends

        if is_half_brick:
            if last:
                print j
                T = Translation([dx - length/2, 0, dy])
            else:
                T = Translation([dx - length/2-gap/2, 0, dy])
            #T = Translation([dx, 0, dy])
            e = elem_half.transformed(T)
            planes.append(draw_frame(e.gripping_frame))
            assembly.add_element(e)
            dx += length/2+gap/1.5
        else:
            T = Translation([dx, 0, dy])
            e = elem_full.transformed(T)
            planes.append(draw_frame(e.gripping_frame))
            assembly.add_element(e)
            dx += width
            
        dx += gap

if transform:
    T = Transformation.from_frame_to_frame(cf, Frame(ptransf.Origin, ptransf.XAxis, ptransf.YAxis))
    assembly.transform(T)
# ---------- end generate_assembly ----------
pln = Plane(generate_assembly.planes)

list_4 = ValueList({"20", "50", "100", "500", "1000", "5000"}, selected="50")
back = Button()
reset = Button()
start = Button()
stop = Button()
step = Button()
full = Button()

jp = GhPythonScript()  # -> configuration_values
# ---------- jp: Python ----------
import math
joint_values = [-3.136, -0.328, -1.218, 3.129, 0.852, 0.008]
#joint_positions = [0] * 6

cart_a = 0
cart_b = 0
c_values_a = [0,0,-90,0,0,0]
c_values_b = [0,0,-90,0,0,0]

configuration_values = [cart_a] + [cart_b] + c_values_a + c_values_b
# ---------- end jp ----------

# ----
# Draw
counter = CountThroughList(
    assembly=generate_assembly.assembly,
    start=start,
    stop=stop,
    step=step,
    step_back=back,
    reset=reset,
    full=full,
    interval=list_4)  # -> item, counter; inputs start: Boolean, stop: Boolean, step_back: Boolean
# ---------- counter: Python ----------
from scriptcontext import sticky as st
from compas_ghpython import update_component


L = list(assembly.elements())
# store data in component
guid = str(ghenv.Component.InstanceGuid)
counter_key = "counter_" + guid
running_key = "running_" + guid

if counter_key not in st:
    st[counter_key] = 0

if running_key not in st:
    st[running_key] = False
    

if st[running_key]:
    if st[counter_key] < len(L) - 1:
        st[counter_key] += 1
        update_component(ghenv, interval)
    else:
        st[counter_key] = 0
        st[running_key] = False
    
    
if start:
    st[running_key] = True

if stop:
    st[running_key] = False

if step:
    if st[counter_key] < len(L) - 1:
        st[counter_key] += 1

if step_back:
    if st[counter_key] < len(L) - 1:
        st[counter_key] -= 1

if reset:
    st[counter_key] = 0

if full:
    st[counter_key] = len(L)-1

if len(L):
    item = L[st[counter_key]]



#st["visualisation_counter"] = st[counter_key]
counter = st[counter_key]
# ---------- end counter ----------
show_2 = BooleanToggle(True)
show_3 = BooleanToggle(False)
idx = Panel(counter.counter)
draw_2 = PythonScript(assembly=generate_assembly.assembly, show_all=show_2, show_counter=show_3, counter=counter.counter)  # -> G, gripping_planes_WCS; inputs counter: Int32
# ---------- draw_2: Python ----------
import os
import sys
from compas_ghpython.artists import MeshArtist

from ur_online_control.assembly import AssemblyArtist
from compas_ghpython import draw_frame

gripping_planes_WCS = []

G = []

if show_all and not show_counter:
    artist = AssemblyArtist(assembly)
    G = artist.draw()

if show_counter:
    for entry in list(assembly.elements())[:counter+1]:
        element = entry[1]
        #print(element)
        artist = MeshArtist(element.mesh)
        mesh = artist.draw_mesh()
        G.append(mesh)
    
    for entry in assembly.elements(data=True):
        print(entry)
        element = entry[1]
        print(element.gripping_frame)
        print element.id
        gripping_planes_WCS.append(draw_frame(entry[1].gripping_frame))
        
    
#print list(assembly.elements())
# ---------- end draw_2 ----------
geo = Geometry(draw_2.G)
pln_2 = Plane(draw_2.gripping_planes_WCS)
preview = CustomPreview(Geometry=pln_2, Shader=ColourSwatch(SwatchColor=RGBA(209, 27, 27, 178)))
preview_2 = CustomPreview(Geometry=geo, Shader=ColourSwatch(SwatchColor=RGBA(255, 186, 186, 146)))

# ---- group: forward kinematics
# Configuration
number_slider = Slider(40.1, range=-90..150)
b_cart = Slider(0, range=-15.66..0)
forward_kinematics = PythonScript(
    robot=robot,
    reset_configuration=Button(),
    configuration_values=jp,
    a_cart=Slider(0, range=0..15.66),
    b_cart=b_cart,
    a_a1=Slider(90, range=-180..180),
    a_a2=Slider(32.7, range=-90..150),
    a_a3=Slider(56.9, range=-180..180),
    a_a4=Slider(0, range=-400..400),
    a_a5=Slider(-91.7, range=-125..120),
    a_a6=Slider(0, range=-400..400),
    b_a1=Slider(-90, range=-180..180),
    b_a2=number_slider,
    b_a3=Slider(-90.4, range=-180..180),
    b_a4=Slider(0, range=-400..400),
    b_a5=Slider(-45.7, range=-125..120),
    b_a6=Slider(0, range=-400..400))  # -> configuration; inputs reset_configuration: Boolean, configuration_values: list
# ---------- forward_kinematics: Python ----------
import math
from compas_fab.robots import Configuration


import math
import Grasshopper
from compas_fab.robots import Configuration

if reset_configuration:
    j = 0
    for i in range(ghenv.Component.Params.Input.Count):
        nslider = ghenv.Component.Params.Input[i].Sources[0]
        if nslider.GetType() == Grasshopper.Kernel.Special.GH_NumberSlider:
            nslider.TrySetSliderValue(configuration_values[j])
            j += 1

if robot:
    
    #types = robot.get_configurable_joint_types()
    #print types
    types = [2,2,0,0,0,0,0,0,0,0,0,0,0,0]
    joint_positions = [a_cart]
    joint_positions += [b_cart]
    joint_positions += [math.radians(a) for a in [a_a1, a_a2, a_a3, a_a4, a_a5, a_a6]]
    joint_positions += [math.radians(a) for a in [b_a1, b_a2, b_a3, b_a4, b_a5, b_a6]]
    configuration = Configuration(joint_positions, types)
    print configuration
# ---------- end forward_kinematics ----------

# ----
# Visualisation
list_5 = ValueList({"forward_kinematics": 0, "inverse_kinematics": 1, "calculated_path": 2}, selected="forward_kinematics")
filter = StreamFilter(Gate=list_5, Stream0=forward_kinematics)
show_end_effector_frame = BooleanToggle(True)
show_base_frame = BooleanToggle(True)
show_collision = BooleanToggle(False)
show_visual = BooleanToggle(True)
show_axes = BooleanToggle(True)
visualize = PythonScript(
    robot=robot,
    configuration=filter,
    show_visual=show_visual,
    show_collision=show_collision,
    show_axes=show_axes,
    show_base_frame=show_base_frame,
    show_end_effector_frame=show_end_effector_frame)  # -> visual, collision, axes, axes_color, ee_frame, ee_color, base_frame, base_color
# ---------- visualize: Python ----------
from System.Drawing import Color

from compas.geometry import Vector
from compas.geometry import Point
from compas.geometry import Frame
from compas_ghpython import draw_pipes

from compas_fab.robots import Configuration

import compas_fab
print compas_fab.HERE

frames = []

size = .100
radius = .001

red = Color.FromArgb(255, 0, 0)
green = Color.FromArgb(0, 255, 0)
blue = Color.FromArgb(0, 0, 255)

frame_colors = [red, green, blue]

def pipes_from_frame(frame, size, radius):
    pipes = []
    for axis in [frame.xaxis, frame.yaxis, frame.zaxis]:
        pipe = {}
        pipe['points'] = [list(frame.point), list(Point(*frame.point) + Vector(*axis) * size)]
        pipe['radius'] = radius
        pipes.append(pipe)
    return pipes

if robot and configuration:
    print ('Setting robot configuration:')
    print (configuration)
    robot.artist.update(configuration, robot.get_configurable_joint_names(), visual=show_visual, collision=show_collision)

    if show_visual:
        visual = robot.artist.draw_visual()
    if show_collision:
        collision = robot.artist.draw_collision()
    
    joint_names = robot.get_configurable_joint_names()
    joint_state = dict(zip(joint_names, configuration.values))
    
    frames = robot.transformed_frames(joint_state)
    axes = robot.transformed_axes(joint_state)
    
    if show_axes:
        pipes = []
        axes_color = []
        for frame in frames:
            pipes += pipes_from_frame(frame, size, radius)
            axes_color += frame_colors
        axes = draw_pipes(pipes, cap=1)


    if show_end_effector_frame:
        ee_link_name = robot.get_end_effector_link_name()
        ee_frame = robot.forward_kinematics(joint_state, ee_link_name)
        ee_pipes = pipes_from_frame(ee_frame, size, radius)
        ee_frame = draw_pipes(ee_pipes, cap=1)
        ee_color = frame_colors

    if show_base_frame:
        link = robot.get_link_by_name(robot.get_base_link_name())
        if link.parent_joint:
            base_frame = link.parent_joint.origin.copy()
        else:
            base_frame = Frame.worldXY()
        base_pipes = pipes_from_frame(base_frame, size, radius)
        base_frame = draw_pipes(base_pipes, cap=1)
        base_color = frame_colors
# ---------- end visualize ----------
preview_3 = CustomPreview(Geometry=visualize.axes, Shader=visualize.axes_color)
preview_4 = CustomPreview(Geometry=visualize.base_frame, Shader=visualize.base_color)
preview_5 = CustomPreview(Geometry=visualize.ee_frame, Shader=visualize.ee_color)
geo_2 = Geometry(visualize.visual)
geo_3 = Geometry(visualize.collision)
