# Grasshopper definition robotic_setup_alte_schmiede_artist.ghx (Grasshopper 1.0.7)

reload = Button()

# ----
# Filepath
panel = Panel("abb_linear_axis_overhead_two_robots.urdf")
list = ValueList({"abb_linear_axis_overhead"}, selected="abb_linear_axis_overhead")
list_2 = ValueList({"abb_irb4600_40_255", "staubli_tx60l"}, selected="abb_irb4600_40_255")
list_3 = ValueList({"abb_end_effectors", "abb_irb4600_40_255", "staubli_tx60l"}, selected="abb_end_effectors")
py = PythonScript()  # -> ghfile_path
# ---------- py: Python ----------
import os

filepath = ghenv.Component.OnPingDocument().FilePath
ghfile_path = os.path.dirname(filepath)
# ---------- end py ----------
py_2 = PythonScript(ghfile_path=py)  # -> robot_description
# ---------- py_2: Python ----------
import os

robot_description = os.path.join(ghfile_path, "..", "data", "robot_description")
robot_description = os.path.abspath(robot_description)
# ---------- end py_2 ----------
py_3 = PythonScript(path=py_2, packages=[list_2, list, list_3])  # -> loaders; inputs packages: list
# ---------- py_3: Python ----------
from compas.robots import LocalPackageMeshLoader

loaders = []
for package in packages:
    loaders.append(LocalPackageMeshLoader(path, package))
    
    
print loaders
# ---------- end py_3 ----------
py_4 = PythonScript(path=py_2, package=list, urdf_name=panel)  # -> package_path, urdf_filename
# ---------- py_4: Python ----------
import os

package_path = os.path.join(path, package)

urdf_filename = os.path.join(package_path, "urdf", urdf_name)

print urdf_filename
assert os.path.isfile(urdf_filename)
# ---------- end py_4 ----------

py_5 = PythonScript(reload=reload)
# ---------- py_5: Python ----------
if reload:
    from compas_ghpython import unload_modules
    unload_modules('compas')
# ---------- end py_5 ----------

# ----
# Robot
load = Button()
python = PythonScript(loaders=py_3, urdf_filename=py_4.urdf_filename, load=load)  # -> robot; inputs loaders: list
# ---------- python: Python ----------
from scriptcontext import sticky as st

import compas

from compas.robots import RobotModel
from compas.robots import GithubPackageMeshLoader
from compas_fab.ghpython import RobotArtist

# Robot meshes are usually in meters
# Set a high percision to prevent parsing errors
# and configure Rhino itself in meters
compas.PRECISION = '12f'

# Store robot in component-based key
robot_key = 'robot_{}'.format(str(ghenv.Component.InstanceGuid))

if robot_key not in st:
    st[robot_key] = None

if load:

    robot = RobotModel.from_urdf_file(urdf_filename)
    robot.load_geometry(*loaders)
    robot.artist = RobotArtist(robot)

    st[robot_key] = robot

robot = st[robot_key]
# ---------- end python ----------
robot = Data(python)

jp = GhPythonScript()  # -> configuration_values
# ---------- jp: Python ----------
import math
joint_values = [-3.136, -0.328, -1.218, 3.129, 0.852, 0.008]
#joint_positions = [0] * 6

cart_a = 0
cart_b = 0
c_values_a = [0,0,-90,0,0,0]
c_values_b = [0,0,-90,0,0,0]

configuration_values = [cart_a] + [cart_b] + c_values_a + c_values_b
# ---------- end jp ----------

# ---- group: forward kinematics
# Configuration
number_slider = Slider(0, range=0..15.66)
b_cart = Slider(0, range=-15.66..0)
forward_kinematics = PythonScript(
    robot=robot,
    reset_configuration=Button(),
    configuration_values=jp,
    a_cart=number_slider,
    b_cart=b_cart,
    a_a1=Slider(0, range=-180..180),
    a_a2=Slider(0, range=-90..150),
    a_a3=Slider(-90, range=-180..180),
    a_a4=Slider(0, range=-400..400),
    a_a5=Slider(0, range=-125..120),
    a_a6=Slider(0, range=-400..400),
    b_a1=Slider(0, range=-180..180),
    b_a2=Slider(0, range=-90..150),
    b_a3=Slider(-90, range=-180..180),
    b_a4=Slider(0, range=-400..400),
    b_a5=Slider(0, range=-125..120),
    b_a6=Slider(0, range=-400..400))  # -> configuration; inputs reset_configuration: Boolean, configuration_values: list
# ---------- forward_kinematics: Python ----------
import math
from compas_fab.robots import Configuration


import math
import Grasshopper
from compas_fab.robots import Configuration

if reset_configuration:
    j = 0
    for i in range(ghenv.Component.Params.Input.Count):
        nslider = ghenv.Component.Params.Input[i].Sources[0]
        if nslider.GetType() == Grasshopper.Kernel.Special.GH_NumberSlider:
            nslider.TrySetSliderValue(configuration_values[j])
            j += 1

if robot:
    
    #types = robot.get_configurable_joint_types()
    #print types
    types = [2,2,0,0,0,0,0,0,0,0,0,0,0,0]
    joint_positions = [a_cart]
    joint_positions += [b_cart]
    joint_positions += [math.radians(a) for a in [a_a1, a_a2, a_a3, a_a4, a_a5, a_a6]]
    joint_positions += [math.radians(a) for a in [b_a1, b_a2, b_a3, b_a4, b_a5, b_a6]]
    configuration = Configuration(joint_positions, types)
    print configuration
# ---------- end forward_kinematics ----------

# ----
# Visualisation
list_4 = ValueList({"forward_kinematics": 0, "inverse_kinematics": 1, "calculated_path": 2}, selected="forward_kinematics")
filter = StreamFilter(Gate=list_4, Stream0=forward_kinematics)
show_end_effector_frame = BooleanToggle(True)
show_base_frame = BooleanToggle(True)
show_collision = BooleanToggle(False)
show_visual = BooleanToggle(True)
show_axes = BooleanToggle(True)
visualize = PythonScript(
    robot=robot,
    configuration=filter,
    show_visual=show_visual,
    show_collision=show_collision,
    show_axes=show_axes,
    show_base_frame=show_base_frame,
    show_end_effector_frame=show_end_effector_frame)  # -> visual, collision, axes, axes_color, ee_frame, ee_color, base_frame, base_color
# ---------- visualize: Python ----------
from System.Drawing import Color

from compas.geometry import Vector
from compas.geometry import Point
from compas.geometry import Frame
from compas_ghpython import draw_pipes

from compas_fab.robots import Configuration

import compas_fab
print compas_fab.HERE

frames = []

size = .100
radius = .001

red = Color.FromArgb(255, 0, 0)
green = Color.FromArgb(0, 255, 0)
blue = Color.FromArgb(0, 0, 255)

frame_colors = [red, green, blue]

def pipes_from_frame(frame, size, radius):
    pipes = []
    for axis in [frame.xaxis, frame.yaxis, frame.zaxis]:
        pipe = {}
        pipe['points'] = [list(frame.point), list(Point(*frame.point) + Vector(*axis) * size)]
        pipe['radius'] = radius
        pipes.append(pipe)
    return pipes

if robot and configuration:
    print ('Setting robot configuration:')
    print (configuration)
    robot.artist.update(configuration, robot.get_configurable_joint_names(), visual=show_visual, collision=show_collision)

    if show_visual:
        visual = robot.artist.draw_visual()
    if show_collision:
        collision = robot.artist.draw_collision()
    
    joint_names = robot.get_configurable_joint_names()
    joint_state = dict(zip(joint_names, configuration.values))
    
    frames = robot.transformed_frames(joint_state)
    axes = robot.transformed_axes(joint_state)
    
    if show_axes:
        pipes = []
        axes_color = []
        for frame in frames:
            pipes += pipes_from_frame(frame, size, radius)
            axes_color += frame_colors
        axes = draw_pipes(pipes, cap=1)


    if show_end_effector_frame:
        ee_link_name = robot.get_end_effector_link_name()
        ee_frame = robot.forward_kinematics(joint_state, ee_link_name)
        ee_pipes = pipes_from_frame(ee_frame, size, radius)
        ee_frame = draw_pipes(ee_pipes, cap=1)
        ee_color = frame_colors

    if show_base_frame:
        link = robot.get_link_by_name(robot.get_base_link_name())
        if link.parent_joint:
            base_frame = link.parent_joint.origin.copy()
        else:
            base_frame = Frame.worldXY()
        base_pipes = pipes_from_frame(base_frame, size, radius)
        base_frame = draw_pipes(base_pipes, cap=1)
        base_color = frame_colors
# ---------- end visualize ----------
preview = CustomPreview(Geometry=visualize.axes, Shader=visualize.axes_color)
preview_2 = CustomPreview(Geometry=visualize.base_frame, Shader=visualize.base_color)
preview_3 = CustomPreview(Geometry=visualize.ee_frame, Shader=visualize.ee_color)
geo = Geometry(visualize.visual)
geo_2 = Geometry(visualize.collision)
