# Grasshopper definition robotic_setup_alte_schmiede_overhead_floor.ghx (Grasshopper 1.0.7)

reload = Button()
brep = Brep(<brep referenced from the Rhino model>)
connect = Button()

# ----
# Element
# Predefine an element and its dimensions
# Visualise the defined element
show = BooleanToggle(False)
# Brick Assembly
elem_def = GhPythonScript()  # -> out, elem_full, elem_half
# ---------- elem_def: Python ----------
import os
import sys
import json

from compas.geometry import Frame
from compas.geometry import Vector
from compas.geometry import Box
from compas_fab.robots import Configuration

from ur_online_control.assembly import Element




# 
width = 0.0115*3
length = 0.024*3
height = 0.05*3

#tolerance_vector = Vector(0, 0, 1.)
#savelevel_vector = Vector(0, 0, 50.)

#picking_frame = Frame([-0.43, 0, height], [1, 0, 0], [0, 1, 0])
#picking_configuration = Configuration.from_revolute_values([-6.027, 4.443, -2.313, 5.724, 1.571, -2.885])

# full brick
box_frame = Frame([-length/2., -width/2., 0.], [1, 0, 0], [0, 1, 0]) #center of the box frame 
box = Box(box_frame, length, width, height) 
gripping_frame = Frame([0, 0, height], [1, 0, 0], [0, -1, 0])
elem_full = Element.from_shape(box, gripping_frame)
elem_full.id = "full"

# half brick
box_frame = Frame([-length/4., -width/2., 0.], [1, 0, 0], [0, 1, 0]) #center of the box frame 
box = Box(box_frame, length/2, width, height) 
gripping_frame = Frame([0, 0, height], [1, 0, 0], [0, -1, 0])
elem_half = Element.from_shape(box, gripping_frame)
elem_half.id = "half"
# ---------- end elem_def ----------
draw = PythonScript(elem_full=elem_def.elem_full, elem_half=elem_def.elem_half, show=show)  # -> M, F, S
# ---------- draw: Python ----------
from compas.geometry import Transformation
from compas.geometry import Frame
from compas.datastructures import mesh_transformed
from compas_ghpython.artists import MeshArtist
from compas_ghpython import draw_frame

if show:
    artist = MeshArtist(elem_full.mesh)
    M = [artist.draw_mesh()]
    F = [draw_frame(elem_full.frame)]
    S = [draw_frame(elem_full._source.frame)]
    
    artist = MeshArtist(elem_half.mesh)
    M += [artist.draw_mesh()]
    F += [draw_frame(elem_half.frame)]
    S += [draw_frame(elem_half.frame)]
# ---------- end draw ----------

load = Button()
py = PythonScript(reload=reload)
# ---------- py: Python ----------
if reload:
    from compas_ghpython import unload_modules
    unload_modules('compas')
    unload_modules("compas_fab")
    unload_modules("ur_online_control")
# ---------- end py ----------
# 1. Choose urdf file name
#  -->
list = ValueList({"abb_linear_axis_floor": "abb_linear_axis_floor_two_robots.urdf", "abb_linear_axis_overhead": "abb_linear_axis_overhead_two_robots.urdf", "abb_linear_axis_overhead_side": "abb_linear_axis_overhead_two_robots_side.urdf", "abb_linear_axis_overhead_low": "abb_linear_axis_overhead_two_robots_low.urdf", "abb_overhead_floor": "abb_overhead_floor.urdf"}, selected="abb_overhead_floor")

# ---- group: ROS client
# 2. When the docker image is running, you can connect the ROS client:
# 2a) restart
# 2b) connect
list_2 = ValueList({"local_host": "127.0.0.1", "10.10.0.1"}, selected="local_host")
# Pass collision objects to planning scene
disconnect = Button()
restart = Button()
ros = PythonScript(ip=list_2, restart=restart)  # -> out, ros_client
# ---------- ros: Python ----------
import sys
import time
import logging
import scriptcontext as sc

from compas_fab.backends import RosClient

from System import TimeSpan
from System.Threading import ManualResetEventSlim

LOGGER = logging.getLogger('roslibpy')


key = 'rosclient_%s' % str(ghenv.Component.InstanceGuid)
previous_client = sc.sticky.get(key, None)
if previous_client:
    previous_client.terminate()

ros_client = RosClient(ip, 9090)
sc.sticky[key] = ros_client

if restart:
    waitLock = ManualResetEventSlim(False)
    
    ros_client.on_ready(lambda: waitLock.Set())
    
    if not waitLock.Wait(TimeSpan.FromSeconds(5)):
        raise Exception('Unable to connect to ROS')
    
    LOGGER.info('ROS connection opened')
# ---------- end ros ----------
connect_2 = PythonScript(ros_client=ros.ros_client, connect=connect, disconnect=disconnect)  # -> is_connected, ros_client
# ---------- connect_2: Python ----------
import logging
from System import TimeSpan
from System.Threading import ManualResetEventSlim

LOGGER = logging.getLogger('roslibpy')

if connect:
    if not ros_client.is_connected:
        LOGGER.debug('Connecting...')
        waitLock = ManualResetEventSlim(False)
        ros_client.on_ready(lambda: waitLock.Set())
        ros_client.connect()

        if not waitLock.Wait(TimeSpan.FromSeconds(5)):
            raise Exception('Unable to connect to ROS')
        LOGGER.debug('Reconnected')

if disconnect:
    if ros_client.is_connected:
        ros_client.terminate()
        LOGGER.debug('Terminated')


is_connected = ros_client.is_connected
# ---------- end connect_2 ----------
panel = Panel(connect_2.is_connected)

# ----
# Filepath
list_3 = ValueList({"abb_irb4600_40_255", "staubli_tx60l"}, selected="abb_irb4600_40_255")
list_4 = ValueList({"abb_end_effectors", "abb_irb4600_40_255", "staubli_tx60l"}, selected="abb_end_effectors")
list_5 = ValueList({"abb_linear_axis", "abb_overhead_floor"}, selected="abb_overhead_floor")
py_2 = PythonScript()  # -> ghfile_path
# ---------- py_2: Python ----------
import os

filepath = ghenv.Component.OnPingDocument().FilePath
ghfile_path = os.path.dirname(filepath)
# ---------- end py_2 ----------
py_3 = PythonScript(ghfile_path=py_2)  # -> robot_description
# ---------- py_3: Python ----------
import os

robot_description = os.path.join(ghfile_path, "..", "data", "robot_description")
robot_description = os.path.abspath(robot_description)
# ---------- end py_3 ----------
py_4 = PythonScript(path=py_3, package=list_5, urdf_name=list, srdf_name="linear_axis_two_robots.srdf")  # -> package_path, urdf_filename, srdf_filename
# ---------- py_4: Python ----------
import os

package_path = os.path.join(path, package)

urdf_filename = os.path.join(package_path, "urdf", urdf_name)
srdf_filename = os.path.join(package_path, srdf_name)

assert os.path.isfile(urdf_filename)
assert os.path.isfile(srdf_filename)
# ---------- end py_4 ----------
py_5 = PythonScript(path=py_3, packages=[list_3, list_5, list_4])  # -> loaders; inputs packages: list
# ---------- py_5: Python ----------
from compas.robots import LocalPackageMeshLoader

loaders = []
for package in packages:
    loaders.append(LocalPackageMeshLoader(path, package))
    
    
print loaders
# ---------- end py_5 ----------

# ----
# Assembly
toggle = BooleanToggle(True)
y_axis = Curve(<curve referenced from the Rhino model>)
x_axis = Curve(<curve referenced from the Rhino model>)
cp = Plane(PlaneXY(0, 0, 0))
plane = PythonScript(plane_axes=[x_axis, y_axis])  # -> plane; inputs plane_axes: list of Curve
# ---------- plane: Python ----------
import Rhino.Geometry as rg

x_axis, y_axis = plane_axes

x_axis = rg.Line(x_axis.PointAtStart, x_axis.PointAtEnd)
y_axis = rg.Line(y_axis.PointAtStart, y_axis.PointAtEnd)

if x_axis.From.DistanceTo(y_axis.From) < 0.01:
    origin = x_axis.From
    xvec = x_axis.Direction
    yvec = y_axis.Direction
elif x_axis.To.DistanceTo(y_axis.To) < 0.01:
    origin = x_axis.To
    xvec = -x_axis.Direction
    yvec = -y_axis.Direction
elif x_axis.From.DistanceTo(y_axis.To) < 0.01:
    origin = x_axis.From
    xvec = x_axis.Direction
    yvec = -y_axis.Direction
elif x_axis.To.DistanceTo(y_axis.From) < 0.01:
    origin = x_axis.To
    xvec = -x_axis.Direction
    yvec = y_axis.Direction

plane = rg.Plane(origin, xvec, yvec)
# ---------- end plane ----------
cp_new = Plane(plane)
generate_assembly = GhPythonScript(centerplane=cp, elem_full=elem_def.elem_full, elem_half=elem_def.elem_half, transform=toggle, ptransf=cp_new)  # -> assembly, planes; inputs ptransf: Plane
# ---------- generate_assembly: Python ----------
import Rhino.Geometry as rg
import math
from scriptcontext import sticky as st


from compas.geometry import Frame
from compas.geometry import Transformation
from compas.geometry import Rotation
from compas.geometry import Translation
from compas.geometry import Point

from compas_ghpython.geometry import xtransformed
from compas_ghpython import draw_frame

from ur_online_control.assembly import Assembly
from ur_online_control.assembly import Element

import Rhino.Geometry as rg



width, length, height = [elem_full._source.xsize, elem_full._source.ysize, elem_full._source.zsize]
#print(width, length, height)

COURSES = 20
BRICKS_PER_COURSE = 5

MORTAR_PERPENDS = 0.015
MORTAR_BEDS = 0.003

total_length = BRICKS_PER_COURSE * width + (BRICKS_PER_COURSE - 1) * MORTAR_PERPENDS
gap_even = MORTAR_PERPENDS
gap_uneven = MORTAR_PERPENDS
#gap_uneven = (total_length - (BRICKS_PER_COURSE * (width)))/BRICKS_PER_COURSE



assembly = Assembly() # initialize an empty assembly class
planes = [] # just for vizualisation


#cp.Rotate(math.radians(90), cp.ZAxis, cp.Origin)
#cp.Translate(rg.Vector3d(0,0,1))
cp = centerplane
cf = Frame(cp.Origin, cp.XAxis, cp.YAxis)

for row in range(COURSES):
    dy = row * height
    half_brick_ends = row % 2 != 0
    gap = gap_even if row % 2 == 0 else gap_uneven
    dx = 0

    bricks_in_course = BRICKS_PER_COURSE + (1 if half_brick_ends else 0)
    for j in range(bricks_in_course):

        first = j == 0
        last = j == bricks_in_course - 1

        is_half_brick = (first or last) and half_brick_ends

        if is_half_brick:
            if last:
                print j
                T = Translation([dx - length/2, 0, dy])
            else:
                T = Translation([dx - length/2-gap/2, 0, dy])
            #T = Translation([dx, 0, dy])
            e = elem_half.transformed(T)
            planes.append(draw_frame(e.gripping_frame))
            assembly.add_element(e)
            dx += length/2+gap/1.5
        else:
            T = Translation([dx, 0, dy])
            e = elem_full.transformed(T)
            planes.append(draw_frame(e.gripping_frame))
            assembly.add_element(e)
            dx += width
            
        dx += gap

if transform:
    T = Transformation.from_frame_to_frame(cf, Frame(ptransf.Origin, ptransf.XAxis, ptransf.YAxis))
    assembly.transform(T)
# ---------- end generate_assembly ----------
pln = Plane(generate_assembly.planes)

# ----
# Robot
python = PythonScript(loaders=py_5, urdf_filename=py_4.urdf_filename, srdf_filename=py_4.srdf_filename, load=load)  # -> robot; inputs loaders: list
# ---------- python: Python ----------
from scriptcontext import sticky as st

import compas

from compas.robots import RobotModel
from compas.robots import GithubPackageMeshLoader
from compas_fab.ghpython import RobotArtist

from compas_fab.robots import Robot
from compas_fab.robots import RobotSemantics

# Robot meshes are usually in meters
# Set a high percision to prevent parsing errors
# and configure Rhino itself in meters
compas.PRECISION = '12f'

# Store robot in component-based key
robot_key = 'robot_{}'.format(str(ghenv.Component.InstanceGuid))

if robot_key not in st:
    st[robot_key] = None

if load:
    
    model = RobotModel.from_urdf_file(urdf_filename)
    model.load_geometry(*loaders)
    artist = RobotArtist(model)
    semantics = RobotSemantics.from_srdf_file(srdf_filename, model)
    robot = Robot(model, artist, semantics, client=None)
    
    st[robot_key] = robot
    

    #robot = RobotModel.from_urdf_file(urdf_filename)
    #robot.load_geometry(*loaders)
    #robot.artist = RobotArtist(robot)
    
    #semantics = RobotSemantics.from_srdf_file(srdf_filename, model)
    #robot = Robot(model, artist, semantics, client=None)

    #st[robot_key] = robot

robot = st[robot_key]

print robot.get_configurable_joint_names()
# ---------- end python ----------
robot = Data(python)

# ----
# Planning scene
scene = PythonScript(robot=robot)  # -> scene
# ---------- scene: Python ----------
from scriptcontext import sticky as st

from compas_fab.robots import PlanningScene

# store scene in component
guid = str(ghenv.Component.InstanceGuid)
scene_key = "scene_" + guid

if scene_key not in st:
    st[scene_key] = None

if robot:
    st[scene_key] = PlanningScene(robot)

scene = st[scene_key]
# ---------- end scene ----------

set = PythonScript(robot=robot, client=connect_2.ros_client)
# ---------- set: Python ----------
if robot and client:
    robot.client = client
# ---------- end set ----------

list_6 = ValueList({"20", "50", "100", "500", "1000", "5000"}, selected="50")
back = Button()
reset = Button()
start = Button()
stop = Button()
step = Button()
full = Button()

# ---- group: forward kinematics
# Configuration
number_slider = Slider(-90, range=-180..180)
jp = GhPythonScript(urdf_name=list)  # -> configuration_values
# ---------- jp: Python ----------
import math
joint_values = [-3.136, -0.328, -1.218, 3.129, 0.852, 0.008]
#joint_positions = [0] * 6

cart_a = 0
cart_b = 1


#overhead
if urdf_name == "abb_linear_axis_overhead_two_robots.urdf":
    c_values_a = [90,0,60,0,-80,0]
    c_values_b = [-90,0,60,0,-80,0]
    
#overhead low
if urdf_name == "abb_linear_axis_overhead_two_robots_low.urdf":
    c_values_a = [90,0,60,0,-80,0]
    c_values_b = [-90,0,60,0,-80,0]

#floor
if urdf_name == "abb_linear_axis_floor_two_robots.urdf":
    c_values_a = [-90,0,0,0,0,0]
    c_values_b = [90,0,0,0,0,0]

#overhead side
if urdf_name == "abb_linear_axis_overhead_two_robots_side.urdf":
    c_values_a = [0,-45,30,0,-65,0]
    c_values_b = [0,-45,30,0,-65,0]
    
if urdf_name == "abb_overhead_floor.urdf":
    c_values_a = [90,0,0,0,0,0]
    c_values_b = [-90,0,0,0,0,0]

configuration_values = [cart_a] + [cart_b] + c_values_a + c_values_b
# ---------- end jp ----------
forward_kinematics = PythonScript(
    robot=robot,
    reset_configuration=Button(),
    configuration_values=jp,
    a_cart=Slider(0, range=0..15.66),
    b_cart=Slider(1, range=0..15.66),
    a_a1=Slider(90, range=-180..180),
    a_a2=Slider(0, range=-90..150),
    a_a3=Slider(0, range=-180..180),
    a_a4=Slider(0, range=-400..400),
    a_a5=Slider(0, range=-125..120),
    a_a6=Slider(0, range=-400..400),
    b_a1=number_slider,
    b_a2=Slider(0, range=-90..150),
    b_a3=Slider(0, range=-180..180),
    b_a4=Slider(0, range=-400..400),
    b_a5=Slider(0, range=-125..120),
    b_a6=Slider(0, range=-400..400))  # -> configuration; inputs reset_configuration: Boolean, configuration_values: list
# ---------- forward_kinematics: Python ----------
import math
from compas_fab.robots import Configuration


import math
import Grasshopper
from compas_fab.robots import Configuration

if reset_configuration:
    j = 0
    for i in range(ghenv.Component.Params.Input.Count):
        nslider = ghenv.Component.Params.Input[i].Sources[0]
        if nslider.GetType() == Grasshopper.Kernel.Special.GH_NumberSlider:
            nslider.TrySetSliderValue(configuration_values[j])
            j += 1

if robot:
    
    
    #joint_types = robot.get_configurable_joint_types()
    #print joint_types
    joint_types = [2,2,0,0,0,0,0,0,0,0,0,0,0,0]
    
    joint_positions = [a_cart]
    joint_positions += [b_cart]
    joint_positions += [math.radians(a) for a in [a_a1, a_a2, a_a3, a_a4, a_a5, a_a6]]
    
    
    joint_positions += [math.radians(a) for a in [b_a1, b_a2, b_a3, b_a4, b_a5, b_a6]]
    
    configuration = Configuration(joint_positions, joint_types)
    print configuration

"""
if robot:
    joint_positions = [a1, a2, a3, a4, a5, a6]
    joint_types = robot.get_configurable_joint_types()
    for i, joint_type in enumerate(joint_types):
        if joint_type == Joint.REVOLUTE:
            joint_positions[i] = math.radians(joint_positions[i])
    full_configuration = Configuration(joint_positions, joint_types)
"""
# ---------- end forward_kinematics ----------

# ----
# Draw
counter = CountThroughList(
    assembly=generate_assembly.assembly,
    start=start,
    stop=stop,
    step=step,
    step_back=back,
    reset=reset,
    full=full,
    interval=list_6)  # -> item, counter; inputs start: Boolean, stop: Boolean, step_back: Boolean
# ---------- counter: Python ----------
from scriptcontext import sticky as st
from compas_ghpython import update_component


L = list(assembly.elements())
# store data in component
guid = str(ghenv.Component.InstanceGuid)
counter_key = "counter_" + guid
running_key = "running_" + guid

if counter_key not in st:
    st[counter_key] = 0

if running_key not in st:
    st[running_key] = False
    

if st[running_key]:
    if st[counter_key] < len(L) - 1:
        st[counter_key] += 1
        update_component(ghenv, interval)
    else:
        st[counter_key] = 0
        st[running_key] = False
    
    
if start:
    st[running_key] = True

if stop:
    st[running_key] = False

if step:
    if st[counter_key] < len(L) - 1:
        st[counter_key] += 1

if step_back:
    if st[counter_key] < len(L) - 1:
        st[counter_key] -= 1

if reset:
    st[counter_key] = 0

if full:
    st[counter_key] = len(L)-1

if len(L):
    item = L[st[counter_key]]



#st["visualisation_counter"] = st[counter_key]
counter = st[counter_key]
# ---------- end counter ----------
show_2 = BooleanToggle(False)
show_3 = BooleanToggle(False)
draw_2 = PythonScript(assembly=generate_assembly.assembly, show_all=show_2, show_counter=show_3, counter=counter.counter)  # -> G, gripping_planes_WCS; inputs counter: Int32
# ---------- draw_2: Python ----------
import os
import sys
from compas_ghpython.artists import MeshArtist

from ur_online_control.assembly import AssemblyArtist
from compas_ghpython import draw_frame

gripping_planes_WCS = []

G = []

if show_all and not show_counter:
    artist = AssemblyArtist(assembly)
    G = artist.draw()

if show_counter:
    for entry in list(assembly.elements())[:counter+1]:
        element = entry[1]
        #print(element)
        artist = MeshArtist(element.mesh)
        mesh = artist.draw_mesh()
        G.append(mesh)
    
    for entry in assembly.elements(data=True):
        print(entry)
        element = entry[1]
        print(element.gripping_frame)
        print element.id
        gripping_planes_WCS.append(draw_frame(entry[1].gripping_frame))
        
    
#print list(assembly.elements())
# ---------- end draw_2 ----------
idx = Panel(counter.counter)
geo = Geometry(draw_2.G)
pln_2 = Plane(draw_2.gripping_planes_WCS)
preview = CustomPreview(Geometry=pln_2, Shader=ColourSwatch(SwatchColor=RGBA(209, 27, 27, 178)))
preview_2 = CustomPreview(Geometry=geo, Shader=ColourSwatch(SwatchColor=RGBA(255, 186, 186, 146)))

list_7 = ValueList({"20", "50", "100", "500", "1000", "5000"}, selected="500")
back_2 = Button()
reset_2 = Button()
start_2 = Button()
stop_2 = Button()
step_2 = Button()
full_2 = Button()

yval = Slider(0, range=-3.501..3.5)
xval = Slider(0, range=-3.5..3.5)
# move slide for changing the target frame z-value
number_slider_2 = Slider(0.3, range=0.1..4.5)

# ----
# Load scene collision objects
mesh = PythonScript()  # -> compas_mesh, M
# ---------- mesh: Python ----------
import os
from compas.datastructures import Mesh
from compas_ghpython.artists import MeshArtist

stlfile = os.path.join(workshop_path, "kuka_kr60","um_kr60_setup", "meshes", "collision", file)
compas_mesh = Mesh.from_stl(stlfile)

M = MeshArtist(compas_mesh).draw_mesh()
# ---------- end mesh ----------
remove = Button()
scale = BooleanToggle(False)
add = Button()

# ----
# Visualisation
# Choose, from which configuration you want to preview your robot model, forward or inverse kinematics, or trajectory planner.
list_8 = ValueList({"forward_kinematics": 0, "inverse_kinematics": 1, "calculated_path": 2}, selected="forward_kinematics")
show_end_effector_frame = BooleanToggle(False)
show_base_frame = BooleanToggle(False)
show_collision = BooleanToggle(False)
show_visual = BooleanToggle(True)
show_axes = BooleanToggle(False)

# ----
# Inverse Kinematics
# Planning groups:
# robotA / robotB --> ik without axis, e.g. from current configuration
# robotA_axis / robotB_axis --> ik with axis
# Start Configuration: If use_start_configuration is set to True, the start configuration is taken from the slider setup. Use wisely, sometimes it is better to set this to False to use the last solved configuration.
list_9 = ValueList({"robotA": "manipulatorA", "robotB": "manipulatorB", "robotA_with_axis": "manipulatorA_axis", "robotB_with_axis": "manipulatorB_axis", "robotA_with_cart": "manipulatorA_cart", "robotB_with_cart": "manipulatorB_cart"}, selected="robotB_with_axis")
py_6 = GhPythonScript(configuration=forward_kinematics)  # -> start_configuration
# ---------- py_6: Python ----------
from compas_fab.robots import Configuration

#L, R = configurationL, configurationR
#start_configuration = Configuration(L.values + R.values, L.types + R.types)

start_configuration = configuration
# ---------- end py_6 ----------

brep_2 = Brep(<brep referenced from the Rhino model>)
contour = Contour(Shape=brep_2, Point=Point(0, 0, 0), Direction=Vector(0, 0, 1), Distance=0.1)

flatten = FlattenTree(Tree=contour, Path="{0}")
item = ListItem(List=flatten, Index=Slider(0, range=0..50), Wrap=True)
item_2 = ListItem(List=flatten, Index=Slider(0, range=0..50), Wrap=True)

divide = DivideCurve(Curve=flatten(item_2), Count=10, Kinks=False)  # -> Points, Tangents, Parameters

counter_2 = CountThroughList(
    pts=divide.Points,
    start=start_2,
    stop=stop_2,
    step=step_2,
    step_back=back_2,
    reset=reset_2,
    full=full_2,
    interval=list_7)  # -> counter; inputs pts: list, start: Boolean, stop: Boolean, step_back: Boolean
# ---------- counter_2: Python ----------
from scriptcontext import sticky as st
from compas_ghpython import update_component


L = pts

guid = str(ghenv.Component.InstanceGuid)
counter_key = "counter__" + guid
running_key = "running__" + guid

if counter_key not in st:
    st[counter_key] = 0

if running_key not in st:
    st[running_key] = False
    

if st[running_key]:
    if st[counter_key] < len(L) - 1:
        st[counter_key] += 1
        update_component(ghenv, interval)
    else:
        st[counter_key] = 0
        st[running_key] = False
    
#st[running_key] = False
if start:
    st[running_key] = True

if stop:
    st[running_key] = False

if step:
    if st[counter_key] < len(L) - 1:
        st[counter_key] += 1

if step_back:
    if st[counter_key] < len(L) - 1:
        st[counter_key] -= 1

if reset:
    st[counter_key] = 0

if full:
    st[counter_key] = len(L)-1

if len(L):
    item = L[st[counter_key]]



#st["visualisation_counter"] = st[counter_key]
counter = st[counter_key]
# ---------- end counter_2 ----------
idx_2 = Panel(counter_2)
item_3 = ListItem(List=divide.Points, Index=counter_2, Wrap=True)

# ---- group: target plane
x_axis_2 = Curve(<curve referenced from the Rhino model>)
y_axis_2 = Curve(<curve referenced from the Rhino model>)
plane_2 = PythonScript(plane_axes=[x_axis_2, y_axis_2], xval=xval, yval=yval, zval=number_slider_2, orient_z=Toggle(False), pt=item_3)  # -> plane; inputs plane_axes: list of Curve, pt: Point3d
# ---------- plane_2: Python ----------
import Rhino.Geometry as rg
import math

x_axis, y_axis = plane_axes

x_axis = rg.Line(x_axis.PointAtStart, x_axis.PointAtEnd)
y_axis = rg.Line(y_axis.PointAtStart, y_axis.PointAtEnd)

if x_axis.From.DistanceTo(y_axis.From) < 0.01:
    origin = x_axis.From
    xvec = x_axis.Direction
    yvec = y_axis.Direction
elif x_axis.To.DistanceTo(y_axis.To) < 0.01:
    origin = x_axis.To
    xvec = -x_axis.Direction
    yvec = -y_axis.Direction
elif x_axis.From.DistanceTo(y_axis.To) < 0.01:
    origin = x_axis.From
    xvec = x_axis.Direction
    yvec = -y_axis.Direction
elif x_axis.To.DistanceTo(y_axis.From) < 0.01:
    origin = x_axis.To
    xvec = -x_axis.Direction
    yvec = y_axis.Direction

plane_o = rg.Plane(origin, xvec, yvec)
plane = rg.Plane(pt, plane_o.XAxis, plane_o.YAxis)

plane.OriginZ += zval
plane.OriginX += xval
plane.OriginY += yval

#plane = rg.Plane(plane_o.Origin, plane_o.XAxis, plane_o.YAxis)

if orient_z:
    plane.Rotate(math.radians(-90), plane.YAxis, plane.Origin)
# ---------- end plane_2 ----------

# ----
# set to true for compute ik
ik = PythonScript(
    compute_ik=Toggle(True),
    robot=robot,
    group=list_9,
    use_start_configuration=Toggle(False),
    start_configuration=py_6,
    plane=plane_2)  # -> out, configuration
# ---------- ik: Python ----------
import scriptcontext as sc
import logging
from scriptcontext import sticky as st

from compas.geometry import Frame

from compas_fab.backends.ros import RosError
from compas_fab.robots import Configuration

if not use_start_configuration:
    #print st
    if 'last_configuration' not in st:
        st['last_configuration'] = start_configuration
    #print st['last_configuration']
    start_configuration = st['last_configuration']

#print start_configuration

if robot and compute_ik:
    if robot.client:
        if robot.client.is_connected:
            print("Robot is connected")
            frame = Frame(plane.Origin, plane.XAxis, plane.YAxis)
            group_configuration = robot.inverse_kinematics(frame, start_configuration=start_configuration, group=group)
            #print(configuration)
            
            #configurationB = Configuration(tuple(start_configuration.values[7:]), tuple(start_configuration.types[7:]))
            #L, R = configurationA, configurationB
            #configuration = Configuration(L.values + R.values, L.types + R.types)
            configuration = robot.merge_group_with_full_configuration(group_configuration, start_configuration, group)
            st['last_configuration'] = configuration
        else:
            print("Robot is not connected")
    else:
        print("Robot is not connected")
        

#print robot.init_configuration()

#print tuple(start_configuration.types[7:])


#print configuration
#print robot.get_group_configuration(group, configuration)
# ---------- end ik ----------
panel_2 = Panel(ik.out)
fk = PythonScript(robot=robot, group=list_9, configuration=ik.configuration)  # -> out, frame_WCF, plane_WCF
# ---------- fk: Python ----------
from compas_ghpython import draw_frame

#print robot.get_end_effector_link_name(group)

frame_RCF = robot.forward_kinematics(configuration, group, backend='model')
#frame_RCF = robot.forward_kinematics(configuration, group, backend=None)
frame_WCF = robot.to_world_coords(frame_RCF, group)

print frame_WCF

plane_WCF = draw_frame(frame_WCF)
# ---------- end fk ----------
pln_3 = Plane(fk.plane_WCF)

filter = StreamFilter(Gate=list_8, Stream0=forward_kinematics, Stream1=ik.configuration)
visualize = PythonScript(
    robot=robot,
    configuration=filter,
    show_visual=show_visual,
    show_collision=show_collision,
    show_axes=show_axes,
    show_base_frame=show_base_frame,
    show_end_effector_frame=show_end_effector_frame)  # -> visual, collision, axes, axes_color, ee_frame, ee_color, base_frame, base_color
# ---------- visualize: Python ----------
from System.Drawing import Color

from compas.geometry import Vector
from compas.geometry import Point
from compas.geometry import Frame
from compas_ghpython import draw_pipes

#from compas_fab.robots import Configuration

import compas_fab
#print compas_fab.HERE

frames = []

size = .100
radius = .001

red = Color.FromArgb(255, 0, 0)
green = Color.FromArgb(0, 255, 0)
blue = Color.FromArgb(0, 0, 255)

frame_colors = [red, green, blue]

def pipes_from_frame(frame, size, radius):
    pipes = []
    for axis in [frame.xaxis, frame.yaxis, frame.zaxis]:
        pipe = {}
        pipe['points'] = [list(frame.point), list(Point(*frame.point) + Vector(*axis) * size)]
        pipe['radius'] = radius
        pipes.append(pipe)
    return pipes

if robot and configuration:
    print ('Setting robot configuration:')
    #print (configuration)
    #print (robot.get_configurable_joint_names())
    #robot.artist.update(configuration, robot.get_configurable_joint_names(), visual=show_visual, collision=show_collision)
    #configuration.joint_names = robot.get_configurable_joint_names() 
    print (configuration)
    robot.artist.update(configuration, visual=show_visual, collision=show_collision)

    if show_visual:
        visual = robot.artist.draw_visual()
    if show_collision:
        collision = robot.artist.draw_collision()
    
    joint_names = robot.get_configurable_joint_names()
    #print joint_names
    joint_state = dict(zip(joint_names, configuration.values))
    
    #print joint_state
    #frames = robot.transformed_frames(joint_state)
    #axes = robot.transformed_axes(joint_state)
    
    axes = robot.transformed_axes(configuration)
    frames = robot.transformed_frames(configuration)
    
    if show_axes:
        pipes = []
        axes_color = []
        for frame in frames:
            pipes += pipes_from_frame(frame, size, radius)
            axes_color += frame_colors
        axes = draw_pipes(pipes, cap=1)


    if show_end_effector_frame:
        ee_link_name = robot.get_end_effector_link_name()
        ee_frame = robot.forward_kinematics(joint_state, ee_link_name)
        ee_pipes = pipes_from_frame(ee_frame, size, radius)
        ee_frame = draw_pipes(ee_pipes, cap=1)
        ee_color = frame_colors

    if show_base_frame:
        link = robot.get_link_by_name(robot.get_base_link_name())
        if link.parent_joint:
            base_frame = link.parent_joint.origin.copy()
        else:
            base_frame = Frame.worldXY()
        base_pipes = pipes_from_frame(base_frame, size, radius)
        base_frame = draw_pipes(base_pipes, cap=1)
        base_color = frame_colors
# ---------- end visualize ----------
geo_2 = Geometry(visualize.visual)
geo_3 = Geometry(visualize.collision)
preview_3 = CustomPreview(Geometry=visualize.axes, Shader=visualize.axes_color)
preview_4 = CustomPreview(Geometry=visualize.ee_frame, Shader=visualize.ee_color)
preview_5 = CustomPreview(Geometry=visualize.base_frame, Shader=visualize.base_color)
preview_6 = CustomPreview(Geometry=geo_2, Shader=ColourSwatch(SwatchColor=RGB(71, 71, 71)))

loft = Loft(Curves=[item_2, item], Options={Adjust=False, Closed=False, LoftEnds=0, LoftSimp=0, LoftType=0, Rebuild=10, Refit=0.01})
bbox = BoundingBox(Content=loft, Plane=PlaneXY(0, 0, 0))  # -> Box, Box_2
mesh_2 = Mesh(bbox.Box)
python_2 = GhPythonScript(guid=mesh_2)  # -> out, cm, rm
# ---------- python_2: Python ----------
import compas_rhino
from compas.datastructures import Mesh
import rhinoscriptsyntax as rs

#from compas_rhino.geometry._constructors.mesh import mesh_from_guid

vertices = [map(float, vertex) for vertex in rs.MeshVertices(guid)]
faces = map(list, rs.MeshFaceVertices(guid))

cm = Mesh.from_vertices_and_faces(vertices, faces)
print cm

from compas_ghpython.artists import MeshArtist

rm = MeshArtist(cm).draw_mesh()
# ---------- end python_2 ----------

collision = PythonScript(scene=scene, compas_mesh=python_2.cm, scale=scale, id="scene_obj", add=add, remove=remove)  # -> out
# ---------- collision: Python ----------
from compas_fab.robots import CollisionMesh

cm = CollisionMesh(compas_mesh, id)

if scene:
    if add:
        scene.add_collision_mesh(cm, scale)
    if remove:
        scene.remove_collision_mesh(id)
# ---------- end collision ----------
panel_3 = Panel(collision)

geo_4 = Geometry(visualize.visual)
